# Dynamo graph Example.dyn (Dynamo 2.1.0.7500)

# group: User Interface (input)
year = DoubleSlider(2022, range=1900..2023 step 1)
month = DoubleSlider(6, range=1..12 step 1)
day = DoubleSlider(17, range=1..31 step 1)
hour_of_day = DoubleSlider(15, range=1..24 step 1)
wind_direction_degree = DoubleSlider(156, range=0..360 step 1)
wind_speed_m_s = DoubleSlider(13, range=0..30 step 1)
air_temperature_celsius_degree = DoubleSlider(39.9, range=0..60 step 0.1)
relative_humidity = DoubleSlider(61, range=30..100 step 1)
radiation_w_m2 = DoubleSlider(1055, range=0..3000 step 1)
surface_orientation_0_sky_1_n_2 = DoubleSlider(4, range=0..8 step 1)  # "Surface orientation (0: sky / 1: N / 2: NE / 3: E / 4: SE / 5: S / 6: SW / 7: W / 8: NW)"
shaded_0_shaded_1_unshaded = DoubleSlider(1, range=0..1 step 1)
material_6_concrete_7_brick = DoubleSlider(7, range=6..7 step 1)
surface_color_0_3_white_0_4 = DoubleSlider(0.6, range=0.3..0.8 step 0.1)  # "Surface color (0.3 white / 0.4 light blue / 0.5 light grey / 0.6 dark grey / 0.7 red / 0.8 dark blue)"
view_factor_to_buildings = DoubleSlider(20, range=0..80 step 10)

byDate = DateTime.ByDate(year=year, month=month, day=day)
create = TimeSpan.Create(hours=hour_of_day)
addTimeSpan = DateTime.AddTimeSpan(dateTime=byDate, timeSpan=create)
dayOfYear = DateTime.DayOfYear(dateTime=byDate)
code_block = CodeBlock(dt1=addTimeSpan, doy=dayOfYear)
# ---------- code_block.designscript (7 lines) ----------
dt=DSCore.DateTime.Components(dt1);
dt3 = (dt["year"] - 1970)*86400*365 + doy*86400 + dt["hour"]*3600 + 518400;
dt2 = Math.RadiansToDegrees(dt3);
dayx = Math.Sin(dt2*(2*Math.PI/86400));
 //NN date input;
dayy = Math.Cos(dt2*(2*Math.PI/86400));
 // NN date input2;
# ----------------------------------------
code_block_2 = CodeBlock(wd=wind_direction_degree, wspeed=wind_speed_m_s) { wrad=Math.DegreesToRadians(wd * 30); wx = wspeed * Math.Cos(wrad); wy = wspeed * Math.Sin(wrad); }
code_block_3 = CodeBlock { 0; 1; -30; 100; }
mapTo = Math.MapTo(rangeMin=code_block_3.out2, rangeMax=code_block_3.out3, inputValue=air_temperature_celsius_degree, targetRangeMin=code_block_3.out0, targetRangeMax=code_block_3.out1)
code_block_4 = CodeBlock(RH=relative_humidity) { RH/100; }
code_block_5 = CodeBlock(Rad=radiation_w_m2) { Rad/3000; }
code_block_6 = CodeBlock(Vb=view_factor_to_buildings) { Vsky=((100-Vb)/2)/100; Vgrnd=((100-Vb)/2)/100; Vbd=Vb/100; }
code_block_7 = CodeBlock(day1=code_block.dayx, day2=code_block.dayy, winx=code_block_2.wx, winy=code_block_2.wy, T=mapTo, RH=code_block_4, Rad=code_block_5, Orient=surface_orientation_0_sky_1_n_2, Shad=shaded_0_shaded_1_unshaded, Mat=material_6_concrete_7_brick, Abso=surface_color_0_3_white_0_4, Vg=code_block_6.Vgrnd, Vs=code_block_6.Vsky, Vb=code_block_6.Vbd)
# ---------- code_block_7.designscript (14 lines) ----------
[List.Flatten([List.Flatten([day1],-1),
List.Flatten([day2],-1),
List.Flatten([winx],-1),
List.Flatten([winy],-1),
List.Flatten([T],-1),
List.Flatten([RH],-1),
List.Flatten([Rad],-1),
List.Flatten([Orient],-1),
List.Flatten([Shad],-1),
List.Flatten([Mat],-1),
List.Flatten([Abso],-1),
List.Flatten([Vg],-1),
List.Flatten([Vs],-1),
List.Flatten([Vb],-1)])];
# ----------------------------------------
buildingSurfTempPredictor14 = ESMUST.ESMUST_prediction.BuildingSurfTempPredictor14(input=code_block_7)
code_block_8 = CodeBlock(temp=buildingSurfTempPredictor14) { Math.Round(temp*100,1); }

# group: Outcome
surface_temperature_celsius = Watch(code_block_8)  # "Surface temperature (Celsius degree)"
